# Grasshopper definition Contour.gh (Grasshopper 1.0.8)
# plug-ins: LunchBox

panel = Panel("{\"version\":10000,\"archive3dm\":80,\"opennurbs\":-1872981175,\"data\":\"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\"}")
sh1 = GetString(panel, AtLeast=1, AtMost=1, TreeAccess=False)
num = Number(60)
base = GetString("{1654.218147, -2040.793376, 0}", AtLeast=1, AtMost=1, TreeAccess=False)
direction = GetString("0,0,900", AtLeast=1, AtMost=1, TreeAccess=False)
deserialize = DeserializeGeometry(SerializedText=sh1, Encryption="JSON")
distance = GetNumber(num, AtLeast=1, AtMost=1, Maximum=1.797693135e+308, Minimum=-1.797693135e+308, TreeAccess=False)
contour = Contour(Shape=deserialize, Point=base, Direction=direction, Distance=distance)
flatten = FlattenTree(Tree=contour, Path="{0}")
c_bake = ContextBake(Content=flatten)
