# Grasshopper definition b2b.gh (Grasshopper 1.0.8)
# plug-ins: LunchBox

panel = Panel("{\"version\":10000,\"archive3dm\":80,\"opennurbs\":-1872981175,\"data\":\"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\"}")
panel_2 = Panel("{\"version\":10000,\"archive3dm\":80,\"opennurbs\":-1872981175,\"data\":\"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\"}")
b1 = GetString(panel_2, AtLeast=1, AtMost=1, TreeAccess=False)
b2 = GetString(panel, AtLeast=1, AtMost=1, TreeAccess=False)
deserialize = DeserializeGeometry(SerializedText=b1, Encryption="JSON")
deserialize_2 = DeserializeGeometry(SerializedText=b2, Encryption="JSON")
bbx = BrepBrep(BrepA=deserialize, BrepB=deserialize_2)  # -> Curves, Points
geo = Geometry(bbx.Curves)
c_bake = ContextBake(Content=geo)
