# Grasshopper definition b2b2.gh (Grasshopper 1.0.8)
# plug-ins: LunchBox

brep = Brep(<brep referenced from the Rhino model>)
brep_2 = Brep(<brep referenced from the Rhino model>)
brep_3 = Brep(<brep referenced from the Rhino model>)
crv = Curve(<curve referenced from the Rhino model>)
crv_2 = Curve(<curve referenced from the Rhino model>)
serialize = SerializeGeometry(Geometry=crv_2, Encryption="JSON")
brep_4 = Brep(<brep referenced from the Rhino model>)
serialize_2 = SerializeGeometry(Geometry=crv, Encryption="JSON")
serialize_3 = SerializeGeometry(Geometry=brep_3, Encryption="JSON")
panel = Panel(serialize_2)
panel_2 = Panel(serialize)
serialize_4 = SerializeGeometry(Geometry=brep_4, Encryption="JSON")
panel_3 = Panel(serialize_3)
panel_4 = Panel(serialize_4)
panel_5 = Panel("{\"version\":10000,\"archive3dm\":80,\"opennurbs\":-1872981175,\"data\":\"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\"}")
panel_6 = Panel("{\"version\":10000,\"archive3dm\":80,\"opennurbs\":-1872981175,\"data\":\"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\"}")
brep_5 = Brep(<brep referenced from the Rhino model>)
c1 = GetString(panel_5, AtLeast=1, AtMost=1, TreeAccess=False)
panel_7 = Panel("{\"version\":10000,\"archive3dm\":80,\"opennurbs\":-1872981175,\"data\":\"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\"}")
c2 = GetString(panel_6, AtLeast=1, AtMost=1, TreeAccess=False)
serialize_5 = SerializeGeometry(Geometry=brep_5, Encryption="JSON")
deserialize = DeserializeGeometry(SerializedText=c1, Encryption="JSON")
panel_8 = Panel(serialize_5)
deserialize_2 = DeserializeGeometry(SerializedText=c2, Encryption="JSON")
bbx = BrepBrep(BrepA=brep, BrepB=brep_2)  # -> Curves, Points
ccx = CurveCurve(CurveA=deserialize, CurveB=deserialize_2)  # -> Points, ParamsA, ParamsB
geo = Geometry(bbx.Curves)

# ---- group: RH_OUT:pt
geo_2 = Geometry(ccx.Points)

# ----
panel_9 = Panel("{\"version\":10000,\"archive3dm\":80,\"opennurbs\":-1872981175,\"data\":\"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\"}")
panel_10 = Panel("{\"version\":10000,\"archive3dm\":80,\"opennurbs\":-1872981175,\"data\":\"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\"}")
b2 = GetString(panel_9, AtLeast=1, AtMost=1, TreeAccess=False)
b1 = GetString(panel_10, AtLeast=1, AtMost=1, TreeAccess=False)
deserialize_3 = DeserializeGeometry(SerializedText=b2, Encryption="JSON")
deserialize_4 = DeserializeGeometry(SerializedText=b1, Encryption="JSON")
bbx_2 = BrepBrep(BrepA=deserialize_4, BrepB=deserialize_3)  # -> Curves, Points
c_bake = ContextBake(Content=bbx_2.Curves)
