# Grasshopper definition b2c-Trim.gh (Grasshopper 1.0.8)
# plug-ins: LunchBox

panel = Panel("""{"version":10000,"archive3dm":80,"opennurbs":-1872981175,"data":"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"}
{"version":10000,"archive3dm":80,"opennurbs":-1872981175,"data":"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"}
{"version":10000,"archive3dm":80,"opennurbs":-1872981175,"data":"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"}
{"version":10000,"archive3dm":80,"opennurbs":-1872981175,"data":"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"}
{"version":10000,"archive3dm":80,"opennurbs":-1872981175,"data":"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"}""")
panel_2 = Panel("{\"version\":10000,\"archive3dm\":80,\"opennurbs\":-1872981175,\"data\":\"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\"}")
b2 = GetString(panel_2, AtLeast=1, AtMost=1, TreeAccess=False)
c1 = GetString(panel, AtLeast=1, AtMost=1, TreeAccess=False)
deserialize = DeserializeGeometry(SerializedText=b2, Encryption="JSON")
deserialize_2 = DeserializeGeometry(SerializedText=c1, Encryption="JSON")
trim = TrimWithBrep(Curve=deserialize_2, Brep=deserialize)  # -> Inside, Outside
crv = Curve(trim.Inside)
c_bake = ContextBake(CurvesIN=trim.Inside)
