# Grasshopper definition cc-RInSECT.gh (Grasshopper 1.0.8)
# plug-ins: LunchBox

panel = Panel("{\"version\":10000,\"archive3dm\":80,\"opennurbs\":-1872981175,\"data\":\"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\"}")
panel_2 = Panel("{\"version\":10000,\"archive3dm\":80,\"opennurbs\":-1872981175,\"data\":\"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\"}")
c1 = GetString(panel, AtLeast=1, AtMost=1, TreeAccess=False)
c2 = GetString(panel_2, AtLeast=1, AtMost=1, TreeAccess=False)
deserialize = DeserializeGeometry(SerializedText=c1, Encryption="JSON")
deserialize_2 = DeserializeGeometry(SerializedText=c2, Encryption="JSON")
rint = RegionIntersection(CurvesA=deserialize_2, CurvesB=deserialize)
geo = Geometry(rint)
c_bake = ContextBake(CrvsPnts=rint)
